# Dynamo graph DisenoVial_AutomatizacionCompleta.dyn (Dynamo 3.5.2.8914)
# Automatizacion diseno vial Civil 3D 2026

capa_eje_de_camino = StringInput("EJE DE CAMINO")
nombre_alineamiento = StringInput("ALI-EJE")
recrear_alineamientos_true_false = BoolSelector(false)  # graph input
paso_1_crear_alineamiento = Python(IN[0]=capa_eje_de_camino, IN[1]=nombre_alineamiento, IN[2]=recrear_alineamientos_true_false)  # IronPython2
# ---------- paso_1_crear_alineamiento.python (130 lines) ----------
# PASO 1: alineamiento NATIVO desde polilinea via PolylineOptions
# (preserva arcos; metodo oficial Autodesk). Firma:
# Alignment.Create(doc, PolylineOptions, name, siteName, layerName, styleName, labelSetName)
# nombres como STRING; siteName=None -> sin sitio.
# OUT = [ [alignment_id, ...], [log...] ]
import clr
clr.AddReference('AcMgd'); clr.AddReference('AcDbMgd'); clr.AddReference('AeccDbMgd')
from Autodesk.AutoCAD.ApplicationServices import Application
from Autodesk.AutoCAD.DatabaseServices import *
from Autodesk.Civil.ApplicationServices import CivilApplication
from Autodesk.Civil.DatabaseServices import Alignment, PolylineOptions

layer_name = IN[0]
ali_base   = IN[1]
forzar     = bool(IN[2]) if IN[2] is not None else False
DEST_LAYER = 'C-ROAD-CNTR'
doc  = Application.DocumentManager.MdiActiveDocument
db   = doc.Database
cdoc = CivilApplication.ActiveDocument
logs = []

def ensure_layer(name):
    with doc.LockDocument():
        with db.TransactionManager.StartTransaction() as tr:
            lt = tr.GetObject(db.LayerTableId, OpenMode.ForRead)
            if not lt.Has(name):
                lt.UpgradeOpen()
                ltr = LayerTableRecord(); ltr.Name = name
                lt.Add(ltr); tr.AddNewlyCreatedDBObject(ltr, True)
            tr.Commit()

def find_alignment(name):
    with doc.LockDocument():
        with db.TransactionManager.StartTransaction() as tr:
            for aid in cdoc.GetAlignmentIds():
                a = tr.GetObject(aid, OpenMode.ForRead)
                if a.Name.upper() == name.upper():
                    tr.Commit(); return aid
            tr.Commit()
    return None

def delete_alignment(name):
    with doc.LockDocument():
        with db.TransactionManager.StartTransaction() as tr:
            for aid in cdoc.GetAlignmentIds():
                a = tr.GetObject(aid, OpenMode.ForRead)
                if a.Name.upper() == name.upper():
                    a.UpgradeOpen(); a.Erase(); tr.Commit(); return
            tr.Commit()

def length_of(oid):
    with doc.LockDocument():
        with db.TransactionManager.StartTransaction() as tr:
            try: L = tr.GetObject(oid, OpenMode.ForRead).Length
            except: L = 0.0
            tr.Commit()
    return L

# pares (estiloAlineamiento, conjuntoEtiquetas) para EN/ES
STYLES = [('Standard', 'Standard'),
          (u'Est\xe1ndar', u'Est\xe1ndar'),
          ('Standard', '_No Labels'),
          (u'Est\xe1ndar', u'_Sin etiquetas'),
          ('Standard', None)]

def create_native(pid, name):
    errs = []
    for sN, lN in STYLES:
        try:
            plops = PolylineOptions()
            plops.AddCurvesBetweenTangents = False
            plops.EraseExistingEntities = False
            plops.PlineId = pid
            with doc.LockDocument():
                aid = Alignment.Create(cdoc, plops, name, None, DEST_LAYER, sN, lN)
            return aid, None
        except Exception as e:
            errs.append((sN or 'None') + '/' + (lN or 'None') + ':' + str(e))
    return None, ' | '.join(errs)

try:
    plines = []
    with doc.LockDocument():
        with db.TransactionManager.StartTransaction() as tr:
            bt  = tr.GetObject(db.BlockTableId, OpenMode.ForRead)
            btr = tr.GetObject(bt[BlockTableRecord.ModelSpace], OpenMode.ForRead)
            for oid in btr:
                o = tr.GetObject(oid, OpenMode.ForRead)
                if isinstance(o, (Polyline, Polyline2d, Polyline3d)):
                    plines.append(oid)
            tr.Commit()

    if not plines:
        OUT = [[], [u'[ERROR P1] No hay ninguna polilinea en el modelo.']]
    else:
        logs.append(u'[INFO P1] Polilineas encontradas: ' + str(len(plines)))
        ensure_layer(DEST_LAYER)
        aids = []
        one = len(plines) == 1
        for k, pid in enumerate(plines):
            name = ali_base if one else (ali_base + u'-%02d' % (k + 1))
            Lp = length_of(pid)
            existing = find_alignment(name)
            if existing is not None and not forzar:
                # Conservar: la rasante manual dibujada en este alineamiento sobrevive.
                aids.append(existing)
                La = length_of(existing)
                logs.append(u'[OK P1] %s conservado (L=%.3f). Para recrear poner Recrear=True.'
                            % (name, La))
                continue
            elif existing is not None:
                try: delete_alignment(name)
                except Exception as de: logs.append(u'[WARN P1] Borrado: ' + str(de))
            aid, err = create_native(pid, name)
            if aid is None:
                logs.append(u'[WARN P1] ' + name + u': ' + err)
                continue
            aids.append(aid)
            La = length_of(aid)
            d  = abs(Lp - La)
            est = u'OK' if (Lp > 0 and d <= max(0.05, Lp * 0.002)) else u'REVISAR'
            logs.append(u'[OK P1] %s creado | L.poli=%.3f L.ali=%.3f dif=%.3f -> %s'
                        % (name, Lp, La, d, est))
        if not aids:
            logs.append(u'[ERROR P1] Ninguna polilinea pudo convertirse en alineamiento.')
        else:
            logs.append(u'[INFO P1] Alineamientos creados: ' + str(len(aids)))
        OUT = [aids, logs]
except Exception as ex:
    OUT = [[], logs + [u'[ERROR P1] Global: ' + str(ex)]]
# ----------------------------------------
nombre_rasante = StringInput("RASANTE")
nombre_assembly = StringInput("camino")
nombre_superficie_tn = StringInput("TN")
nombre_superficie_sello = StringInput("SELLO")
delta_metros = DoubleInput(0.3)
paso_2_crear_sello = Python(IN[0]=nombre_superficie_tn, IN[1]=nombre_superficie_sello, IN[2]=delta_metros, IN[3]=paso_1_crear_alineamiento)  # IronPython2
# ---------- paso_2_crear_sello.python (90 lines) ----------
# PASO 2: SELLO = TN - delta
# TinSurface.Create espera (nombre, estiloId), NO el CivilDocument.
# Create* fuera de transaccion abierta. Prueba varias firmas y reporta error real.
# OUT = [sello_id, tn_id, logs]
import clr
clr.AddReference('AcMgd'); clr.AddReference('AcDbMgd'); clr.AddReference('AeccDbMgd')
from Autodesk.AutoCAD.ApplicationServices import Application
from Autodesk.AutoCAD.DatabaseServices import *
from Autodesk.AutoCAD.Geometry import Point3d, Point3dCollection
from Autodesk.Civil.ApplicationServices import CivilApplication
from Autodesk.Civil.DatabaseServices import TinSurface

tn_name=IN[0]; sello_name=IN[1]; delta=float(IN[2]); p1=IN[3]
logs=list(p1[1]) if (p1 and len(p1)>1 and p1[1]) else []
doc=Application.DocumentManager.MdiActiveDocument
db=doc.Database
cdoc=CivilApplication.ActiveDocument

def sty(col,*ns):
    for n in ns:
        try: return col[n]
        except: pass
    for s in col: return s
    return ObjectId.Null

def find_surf(name):
    with doc.LockDocument():
        with db.TransactionManager.StartTransaction() as tr:
            r=None
            for sid in cdoc.GetSurfaceIds():
                s=tr.GetObject(sid,OpenMode.ForRead)
                if s.Name.upper()==name.upper(): r=sid; break
            tr.Commit()
    return r

def erase_surf(sid):
    with doc.LockDocument():
        with db.TransactionManager.StartTransaction() as tr:
            tr.GetObject(sid,OpenMode.ForWrite).Erase(); tr.Commit()

def read_verts(sid,dz):
    pts=Point3dCollection()
    with doc.LockDocument():
        with db.TransactionManager.StartTransaction() as tr:
            s=tr.GetObject(sid,OpenMode.ForRead)
            for v in s.Vertices:
                L=v.Location
                pts.Add(Point3d(L.X,L.Y,L.Z-dz))
            tr.Commit()
    return pts

def create_surf(name,styleId):
    errs=[]
    sigs=[
        lambda: TinSurface.Create(name,styleId),
        lambda: TinSurface.Create(db,name),
    ]
    for f in sigs:
        try:
            with doc.LockDocument(): return f(),None
        except Exception as e: errs.append(str(e))
    return None,' | '.join(errs)

try:
    if not p1 or not p1[0]:
        OUT=[None,None,logs+[u'[SKIP P2] PASO 1 sin alineamiento.']]
    else:
        tn_id=find_surf(tn_name)
        if tn_id is None:
            raise ValueError(u'Superficie TN no encontrada: '+tn_name)
        ex=find_surf(sello_name)
        if ex is not None: erase_surf(ex)
        st=sty(cdoc.Styles.SurfaceStyles,'Standard',u'Est\xe1ndar','Estandar')
        pts=read_verts(tn_id,delta)
        sid,err=create_surf(sello_name,st)
        if sid is None:
            raise ValueError(u'TinSurface.Create fallo: '+err)
        with doc.LockDocument():
            with db.TransactionManager.StartTransaction() as tr:
                srf=tr.GetObject(sid,OpenMode.ForWrite)
                if st!=ObjectId.Null:
                    try: srf.StyleId=st
                    except: pass
                srf.AddVertices(pts)
                srf.Rebuild()
                tr.Commit()
        logs.append(u'[OK P2] SELLO = TN - %.3f m (%d vert.)'%(delta,pts.Count))
        OUT=[sid,tn_id,logs]
except Exception as ex:
    OUT=[None,None,logs+[u'[ERROR P2] '+str(ex)]]
# ----------------------------------------
paso_3_vista_de_perfil = Python(IN[0]=paso_1_crear_alineamiento, IN[1]=paso_2_crear_sello)  # IronPython2
# ---------- paso_3_vista_de_perfil.python (105 lines) ----------
# PASO 3: una vista de perfil (TN + SELLO) por CADA alineamiento
# Create* fuera de transaccion abierta; prueba varias firmas; reporta error real.
# OUT = [ [pv_id,...], logs ]
import clr
clr.AddReference('AcMgd'); clr.AddReference('AcDbMgd'); clr.AddReference('AeccDbMgd')
from Autodesk.AutoCAD.ApplicationServices import Application
from Autodesk.AutoCAD.DatabaseServices import *
from Autodesk.AutoCAD.Geometry import Point3d
from Autodesk.Civil.ApplicationServices import CivilApplication
from Autodesk.Civil.DatabaseServices import Profile, ProfileView

p1=IN[0]; p2=IN[1]
logs=list(p2[2]) if (p2 and len(p2)>2 and p2[2]) else []
doc=Application.DocumentManager.MdiActiveDocument
db=doc.Database
cdoc=CivilApplication.ActiveDocument

def sty(col,*ns):
    for n in ns:
        try: return col[n]
        except: pass
    for s in col: return s
    return ObjectId.Null

def ali_info(aid):
    with doc.LockDocument():
        with db.TransactionManager.StartTransaction() as tr:
            a=tr.GetObject(aid,OpenMode.ForRead)
            nm=a.Name
            ext=a.GeometricExtents
            mnx,mny=ext.MinPoint.X,ext.MinPoint.Y
            mxx,mxy=ext.MaxPoint.X,ext.MaxPoint.Y
            existing=[tr.GetObject(pid,OpenMode.ForRead).Name for pid in a.GetProfileIds()]
            tr.Commit()
    return nm,mnx,mny,mxx,mxy,existing

def make_profile(name,aid,sid,lay):
    ps=sty(cdoc.Styles.ProfileStyles,'Standard',u'Est\xe1ndar','Estandar')
    ls=sty(cdoc.Styles.LabelSetStyles.ProfileLabelSetStyles,'_No Labels','Standard')
    errs=[]
    sigs=[
        lambda: Profile.CreateFromSurface(name,aid,sid,lay,ps,ls),
        lambda: Profile.CreateFromSurface(cdoc,name,aid,sid,lay,ps,ls),
    ]
    for f in sigs:
        try:
            with doc.LockDocument(): return f(),None
        except Exception as e: errs.append(str(e))
    return None,' | '.join(errs)

def make_pv(name,aid,x,y,pvs):
    pt=Point3d(x,y,0.0)
    errs=[]
    sigs=[
        lambda: ProfileView.Create(aid,pt),
        lambda: ProfileView.Create(cdoc,aid,pt),
        lambda: ProfileView.Create(name,aid,pt,pvs),
    ]
    for f in sigs:
        try:
            with doc.LockDocument(): return f(),None
        except Exception as e: errs.append(str(e))
    return None,' | '.join(errs)

try:
    aids=p1[0] if (p1 and p1[0]) else []
    if not aids:
        OUT=[[],logs+[u'[SKIP P3] PASO 1 sin alineamientos.']]
    elif not p2 or p2[0] is None:
        OUT=[[],logs+[u'[SKIP P3] PASO 2 sin SELLO.']]
    else:
        sello_id=p2[0]; tn_id=p2[1]
        pvs=sty(cdoc.Styles.ProfileViewStyles,'Standard',u'Est\xe1ndar','Estandar')
        cl=db.Clayer
        pv_ids=[]
        for k,aid in enumerate(aids):
            try:
                nm,mnx,mny,mxx,mxy,existing=ali_info(aid)
                nTN=u'PERF-TN-'+nm; nSE=u'PERF-SELLO-'+nm
                if nTN not in existing:
                    r,e=make_profile(nTN,aid,tn_id,cl)
                    if r is None: logs.append(u'[WARN P3] perfil TN '+nm+u': '+e)
                if nSE not in existing:
                    r,e=make_profile(nSE,aid,sello_id,cl)
                    if r is None: logs.append(u'[WARN P3] perfil SELLO '+nm+u': '+e)
                px=mxx+150.0; py=mny-k*250.0
                pid,e=make_pv(u'PV-'+nm,aid,px,py,pvs)
                if pid is None:
                    logs.append(u'[WARN P3] vista '+nm+u': '+e); continue
                with doc.LockDocument():
                    with db.TransactionManager.StartTransaction() as tr:
                        pv=tr.GetObject(pid,OpenMode.ForWrite)
                        try: pv.Name=u'PV-'+nm
                        except: pass
                        if pvs!=ObjectId.Null:
                            try: pv.StyleId=pvs
                            except: pass
                        tr.Commit()
                pv_ids.append(pid)
            except Exception as e:
                logs.append(u'[WARN P3] '+str(e))
        logs.append(u'[OK P3] Vistas de perfil creadas: '+str(len(pv_ids)))
        OUT=[pv_ids,logs]
except Exception as ex:
    OUT=[[],logs+[u'[ERROR P3] '+str(ex)]]
# ----------------------------------------
paso_4_crear_corredor = Python(IN[0]=paso_1_crear_alineamiento, IN[1]=nombre_rasante, IN[2]=nombre_assembly, IN[3]=paso_2_crear_sello, IN[4]=paso_3_vista_de_perfil)  # IronPython2
# ---------- paso_4_crear_corredor.python (120 lines) ----------
# PASO 4: un corredor por CADA alineamiento que tenga rasante
# cdoc.GetAssemblyIds() NO existe -> se itera el model space buscando Assembly.
# Create* fuera de transaccion abierta; prueba varias firmas.
# OUT = [ [corridor_id,...], logs ]
import clr
clr.AddReference('AcMgd'); clr.AddReference('AcDbMgd'); clr.AddReference('AeccDbMgd')
from Autodesk.AutoCAD.ApplicationServices import Application
from Autodesk.AutoCAD.DatabaseServices import *
from Autodesk.Civil.ApplicationServices import CivilApplication
from Autodesk.Civil.DatabaseServices import Corridor
from Autodesk.Civil.DatabaseServices import Assembly as CivilAssembly

p1=IN[0]; profile_name=IN[1]; assembly_name=IN[2]; p2=IN[3]; p3=IN[4]
logs=list(p3[1]) if (p3 and len(p3)>1 and p3[1]) else []
doc=Application.DocumentManager.MdiActiveDocument
db=doc.Database
cdoc=CivilApplication.ActiveDocument

def sty(col,*ns):
    for n in ns:
        try: return col[n]
        except: pass
    for s in col: return s
    return ObjectId.Null

def norm(s):
    import unicodedata
    return ''.join(c for c in unicodedata.normalize('NFD',unicode(s)) if unicodedata.category(c)!='Mn').upper()

def find_assembly(name):
    tgt=norm(name)
    with doc.LockDocument():
        with db.TransactionManager.StartTransaction() as tr:
            bt=tr.GetObject(db.BlockTableId,OpenMode.ForRead)
            btr=tr.GetObject(bt[BlockTableRecord.ModelSpace],OpenMode.ForRead)
            r=None; names=[]
            for oid in btr:
                o=tr.GetObject(oid,OpenMode.ForRead)
                if isinstance(o,CivilAssembly):
                    names.append(o.Name)
                    if norm(o.Name)==tgt: r=oid; break
            tr.Commit()
    return r,names

def ali_data(aid,pname):
    with doc.LockDocument():
        with db.TransactionManager.StartTransaction() as tr:
            a=tr.GetObject(aid,OpenMode.ForRead)
            nm=a.Name; s0=a.StartingStation; s1=a.EndingStation
            pr=None; pnames=[]
            for pid in a.GetProfileIds():
                pn=tr.GetObject(pid,OpenMode.ForRead).Name
                pnames.append(pn)
                if pn.upper()==pname.upper(): pr=pid
            tr.Commit()
    return nm,s0,s1,pr,pnames

def make_corridor(name,aid,pr,asm,surf):
    errs=[]
    sigs=[
        lambda: Corridor.Create(name,aid,pr,asm,surf),
        lambda: Corridor.Create(name,aid,pr,asm),
        lambda: Corridor.Create(cdoc,name),
        lambda: Corridor.Create(name),
    ]
    for f in sigs:
        try:
            with doc.LockDocument(): return f(),None
        except Exception as e: errs.append(str(e))
    return None,' | '.join(errs)

try:
    aids=p1[0] if (p1 and p1[0]) else []
    if not aids:
        OUT=[[],logs+[u'[SKIP P4] PASO 1 sin alineamientos.']]
    elif not p3 or not p3[0]:
        OUT=[[],logs+[u'[SKIP P4] PASO 3 sin vistas de perfil.']]
    else:
        sello_id=p2[0] if (p2 and p2[0]) else ObjectId.Null
        asm_id,asm_names=find_assembly(assembly_name)
        if asm_id is None:
            disp=', '.join(asm_names) if asm_names else u'(ninguno en el modelo)'
            raise ValueError(u'Assembly "'+assembly_name+u'" no encontrado. Disponibles: '+disp)
        cst=sty(cdoc.Styles.CorridorStyles,'Standard',u'Est\xe1ndar','Estandar')
        cor_ids=[]
        for aid in aids:
            nm,s0,s1,pr,pnames=ali_data(aid,profile_name)
            if pr is None:
                disp=', '.join(pnames) if pnames else u'(sin perfiles)'
                logs.append(u'[WARN P4] '+nm+u': sin rasante "'+profile_name+
                            u'". Perfiles disponibles: '+disp)
                continue
            cid,err=make_corridor(u'COR-'+nm,aid,pr,asm_id,sello_id)
            if cid is None:
                logs.append(u'[WARN P4] '+nm+u': Corridor.Create fallo: '+err)
                continue
            try:
                with doc.LockDocument():
                    with db.TransactionManager.StartTransaction() as tr:
                        cor=tr.GetObject(cid,OpenMode.ForWrite)
                        if cst!=ObjectId.Null:
                            try: cor.StyleId=cst
                            except: pass
                        bl=cor.Baselines.Add(u'BL-'+nm,aid,pr)
                        reg=bl.BaselineRegions.Add(u'REG-1',asm_id)
                        try: reg.StartStation=s0; reg.EndStation=s1
                        except: pass
                        tr.Commit()
                with doc.LockDocument():
                    with db.TransactionManager.StartTransaction() as tr:
                        tr.GetObject(cid,OpenMode.ForWrite).Rebuild()
                        tr.Commit()
                cor_ids.append(cid)
                logs.append(u'[OK P4] Corredor COR-'+nm+u' creado.')
            except Exception as e:
                logs.append(u'[WARN P4] '+nm+u' config: '+str(e))
        logs.append(u'[INFO P4] Corredores creados: '+str(len(cor_ids))+u' de '+str(len(aids)))
        OUT=[cor_ids,logs]
except Exception as ex:
    OUT=[[],logs+[u'[ERROR P4] '+str(ex)]]
# ----------------------------------------
watch_resultado = Watch(paso_4_crear_corredor)
